# Dynamo graph lesson_01.dyn (Dynamo 2.5.0.7460)

# group: Lesson 1
integer_slider = IntegerSlider(8, range=0..100 step 2)
number_slider = DoubleSlider(10, range=0..100 step 0.1)
byCoordinates = Point.ByCoordinates(x=number_slider, y=number_slider, z=number_slider)
integer_slider_2 = IntegerSlider(0, range=0..100 step 1)
byCoordinates_2 = Point.ByCoordinates(x=integer_slider_2, y=integer_slider_2, z=integer_slider_2)
byStartPointEndPoint = Line.ByStartPointEndPoint(startPoint=byCoordinates, endPoint=byCoordinates_2)

# note: Design Script language
code_block = CodeBlock { p1 = Point.ByCoordinates(0,0,0); p2 = Point.ByCoordinates(10,10,0); myLine = Line.ByStartPointEndPoint(p1, p2); }
